# Grasshopper definition 00. Crab Assembly Lobster.gh (Grasshopper 0.9.76)
# plug-ins: Python Interpreter, Firefly.X, Firefly.Core

timer = Timer(TimerInterval=20, Target=counter)  # disabled
C = Curve(<curve referenced from the Rhino model>)
xy = XYPlane(Origin=Point(0, 0, 0))
mesh = Mesh(<mesh referenced from the Rhino model>)
mesh_2 = Mesh(<mesh referenced from the Rhino model>)
mesh_3 = Mesh(<mesh referenced from the Rhino model>)
mesh_4 = Mesh(<mesh referenced from the Rhino model>)
mesh_5 = Mesh(<mesh referenced from the Rhino model>)
mesh_6 = Mesh(<mesh referenced from the Rhino model>)
mesh_7 = Mesh(<mesh referenced from the Rhino model>)
list = ValueList({"IK": 0, "FK": 1}, selected="FK")
counter = Counter(CountDirection=Toggle(True), Step=".01", StartStop=Toggle(True), Reset=Button(), OptionalCounterDomain="0 to 1")
list_2 = ValueList({"Home": 0, "Target": 1}, selected="Target")
pt = Point(<point referenced from the Rhino model>)
pt_2 = Point(<point referenced from the Rhino model>)
pt_3 = Point(<point referenced from the Rhino model>)
pt_4 = Point(<point referenced from the Rhino model>)
yz = YZPlane(Origin=pt_4)
pframe = PerpFrame(Curve=reparameterize(C), Parameter=Slider(0.202, range=0..1))
filter = StreamFilter(Gate=list_2, Stream0=yz, Stream1=pframe)
c_script = CSharpScript(P1=pt, P2=pt_3, P3=pt_2, P4=pt_4, BasePlane=xy, TargetPlane=filter)  # -> out, A1, A2, A3, A4, A5, A6; inputs P1: Point3d, P2: Point3d, P3: Point3d, P4: Point3d, BasePlane: Plane, TargetPlane: Plane
# ---------- c_script: C# ----------
    //Lobster reloaded
    //Inverse Kinematics definition by Daniel Piker
    //You are free to use and modify without restriction, but acknowledgement is appreciated

    Transform xform = Rhino.Geometry.Transform.PlaneToPlane(BasePlane, Plane.WorldXY);

    Plane EndPlane = new Plane(TargetPlane.Origin, TargetPlane.YAxis, TargetPlane.XAxis);
    double pi = Math.PI;
    double WristOffset = P4.X - P3.X;
    double LowerArmLength = P1.DistanceTo(P2);
    double UpperArmLength = P2.DistanceTo(P3);
    double Axis4offsetAngle = Math.Atan2(P3.Z - P2.Z, P3.X - P2.X);

    P1.Transform(xform);
    P2.Transform(xform);
    P3.Transform(xform);
    P4.Transform(xform);

    Point3d Wrist = new Point3d(EndPlane.PointAt(0, 0, WristOffset));

    List<double> Axis1Angles = new List<double>();
    List<double> Axis2Angles = new List<double>();
    List<double> Axis3Angles = new List<double>();
    List<double> Axis4Angles = new List<double>();
    List<double> Axis5Angles = new List<double>();
    List<double> Axis6Angles = new List<double>();

    double Axis1Angle = -1 * Math.Atan2(Wrist.Y, Wrist.X);
    //note that this is reversed because the clockwise direction when looking down at the XY plane
    //is typically taken as the positive direction for robot axis1

    if(Axis1Angle > Math.PI)
    {
      Axis1Angle -= 2 * Math.PI;
    }

    for (int i = 0; i < 4; i++)
    {
      Axis1Angles.Add(Axis1Angle);
    }

    Axis1Angle += Math.PI;
    if(Axis1Angle > Math.PI)
    {
      Axis1Angle -= 2 * Math.PI;
    }
    for (int i = 0; i < 4; i++)
    {
      Axis1Angles.Add(1 * Axis1Angle);
    }

    for (int i = 0; i < 2; i++)  // to generate 4 sets of values for each option of axis1
    {
      Axis1Angle = Axis1Angles[i * 4];

      Transform Rot1 = Rhino.Geometry.Transform.Rotation(-1 * Axis1Angle, Point3d.Origin);

      Point3d P1A = new Point3d(P1);
      Point3d P2A = new Point3d(P2);
      Point3d P3A = new Point3d(P3);

      P1A.Transform(Rot1);
      P2A.Transform(Rot1);
      P3A.Transform(Rot1);
      Vector3d ElbowDir = new Vector3d(1, 0, 0);
      ElbowDir.Transform(Rot1);
      Plane ElbowPlane = new Rhino.Geometry.Plane(P1A, ElbowDir, Vector3d.ZAxis);

      Sphere Sphere1 = new Sphere(P1A, LowerArmLength);
      Sphere Sphere2 = new Sphere(Wrist, UpperArmLength);
      Circle Circ = new Circle();

      double Par1 = new double();
      double Par2 = new double();

      Rhino.Geometry.Intersect.Intersection.SphereSphere(Sphere1, Sphere2, out Circ);
      Rhino.Geometry.Intersect.Intersection.PlaneCircle(ElbowPlane, Circ, out Par1, out Par2);

      Point3d IntersectPt1 = Circ.PointAt(Par1);
      Point3d IntersectPt2 = Circ.PointAt(Par2);

      for(int j = 0;j < 2;j++)
      {
        Point3d ElbowPt = new Point3d();

        if(j == 0)
        {ElbowPt = IntersectPt1;}
        else
        {ElbowPt = IntersectPt2;}

        double elbowx,elbowy,wristx,wristy; //parameters in the elbow plane

        ElbowPlane.ClosestParameter(ElbowPt, out elbowx, out elbowy);
        ElbowPlane.ClosestParameter(Wrist, out wristx, out wristy);

        double Axis2Angle = Math.Atan2(elbowy, elbowx);
        double Axis3Angle = Math.PI - Axis2Angle + Math.Atan2(wristy - elbowy, wristx - elbowx) - Axis4offsetAngle;

        for(int k = 0;k < 2;k++)
        {
          Axis2Angles.Add(-Axis2Angle);

          double Axis3AngleWrapped = -Axis3Angle + pi;
          while (Axis3AngleWrapped >= pi) Axis3AngleWrapped -= 2 * pi;
          while (Axis3AngleWrapped < -pi) Axis3AngleWrapped += 2 * pi;
          Axis3Angles.Add(Axis3AngleWrapped);
        }

        for(int k = 0;k < 2;k++)
        {
          Vector3d Axis4 = new Vector3d(Wrist - ElbowPt);
          Axis4.Rotate(-Axis4offsetAngle, ElbowPlane.ZAxis);
          Vector3d LowerArm = new Vector3d(ElbowPt - P1A);
          Plane TempPlane = ElbowPlane;
          TempPlane.Rotate(Axis2Angle + Axis3Angle, TempPlane.ZAxis);

          // B = TempPlane;
          Plane Axis4Plane = new Rhino.Geometry.Plane(Wrist, TempPlane.ZAxis, -1.0 * TempPlane.YAxis);
          double axis6x,axis6y;
          Axis4Plane.ClosestParameter(EndPlane.Origin, out axis6x, out axis6y);

          double Axis4Angle = Math.Atan2(axis6y, axis6x);
          if(k == 1)
          {
            Axis4Angle += Math.PI;
            if(Axis4Angle > Math.PI)
            {
              Axis4Angle -= 2 * Math.PI;
            }
          }

          double Axis4AngleWrapped = Axis4Angle + pi / 2;
          while (Axis4AngleWrapped >= pi) Axis4AngleWrapped -= 2 * pi;
          while (Axis4AngleWrapped < -pi) Axis4AngleWrapped += 2 * pi;
          Axis4Angles.Add(Axis4AngleWrapped);

          Plane Axis5Plane = new Rhino.Geometry.Plane(Axis4Plane);
          Axis5Plane.Rotate(Axis4Angle, Axis4Plane.ZAxis);
          Axis5Plane = new Rhino.Geometry.Plane(Wrist, -Axis5Plane.ZAxis, Axis5Plane.XAxis);
          Axis5Plane.ClosestParameter(EndPlane.Origin, out axis6x, out axis6y);
          double Axis5Angle = Math.Atan2(axis6y, axis6x);
          Axis5Angles.Add(Axis5Angle);

          Plane Axis6Plane = new Rhino.Geometry.Plane(Axis5Plane);
          Axis6Plane.Rotate(Axis5Angle, Axis5Plane.ZAxis);
          Axis6Plane = new Rhino.Geometry.Plane(Wrist, -Axis6Plane.YAxis, Axis6Plane.ZAxis);
          double endx,endy;
          Axis6Plane.ClosestParameter(EndPlane.PointAt(1, 0), out endx, out endy);
          double Axis6Angle = Math.Atan2(endy, endx);
          Axis6Angles.Add(Axis6Angle);
        }
      }
    }
    for(int i = 0;i < 8;i++)
    {
      Axis1Angles[i] = Axis1Angles[i] * 180 / pi;
      Axis2Angles[i] = Axis2Angles[i] * 180 / pi;
      Axis3Angles[i] = Axis3Angles[i] * 180 / pi;
      Axis4Angles[i] = Axis4Angles[i] * 180 / pi;
      Axis5Angles[i] = Axis5Angles[i] * 180 / pi;
      Axis6Angles[i] = Axis6Angles[i] * 180 / pi;
    }
    A1 = Axis1Angles;
    A2 = Axis2Angles;
    A3 = Axis3Angles;
    A4 = Axis4Angles;
    A5 = Axis5Angles;
    A6 = Axis6Angles;
# ---------- end c_script ----------
slider = Slider(3, range=0..7)
item = ListItem(List=c_script.A1, Index=slider, Wrap=False)
item_2 = ListItem(List=c_script.A2, Index=slider, Wrap=False)
item_3 = ListItem(List=c_script.A3, Index=slider, Wrap=False)
item_4 = ListItem(List=c_script.A4, Index=slider, Wrap=False)
item_5 = ListItem(List=c_script.A5, Index=slider, Wrap=False)
item_6 = ListItem(List=c_script.A6, Index=slider, Wrap=False)
panel = Panel([item, item_2, item_3, item_4, item_5, item_6])
cluster = Cluster(a1=c_script.A1, a2=c_script.A2, a3=c_script.A3, a4=c_script.A4, a5=c_script.A5, a6=c_script.A6, solver_id=slider)  # -> a1_2, a2_2, a3_2, a4_2, a5_2, a6_2
number_slider = Slider(-90, range=-180..0)
number_slider_2 = Slider(0, range=-90..90)
number_slider_3 = Slider(90, range=-45..135)
number_slider_4 = Slider(0, range=-90..90)
number_slider_5 = Slider(90, range=-90..90)
filter_2 = StreamFilter(Gate=list, Stream0=cluster.a1_2, Stream1=number_slider_5)
filter_3 = StreamFilter(Gate=list, Stream0=cluster.a2_2, Stream1=number_slider)
filter_4 = StreamFilter(Gate=list, Stream0=cluster.a3_2, Stream1=number_slider_3)
filter_5 = StreamFilter(Gate=list, Stream0=cluster.a4_2, Stream1=number_slider_2)
filter_6 = StreamFilter(Gate=list, Stream0=cluster.a5_2, Stream1=number_slider_4)
filter_7 = StreamFilter(Gate=list, Stream0=cluster.a6_2, Stream1=Slider(0, range=-90..90))
number_slider_6 = Slider(0, range=0..180)
ports_available = COMPortsAvailable()
python = PythonScript(a1=number_slider_5)  # -> out, a1Servo
# ---------- python: Python ----------
#converting robot angle A1 to Servo A1
a1Servo = -a1+90
# ---------- end python ----------
python_2 = PythonScript(x=number_slider)  # -> out, a
# ---------- python_2: Python ----------
a = x+180
# ---------- end python_2 ----------
python_3 = PythonScript(x=number_slider_3)  # -> out, a
# ---------- python_3: Python ----------
a = x+45
# ---------- end python_3 ----------
python_4 = PythonScript(x=number_slider_2)  # -> out, a
# ---------- python_4: Python ----------
a = x+90
# ---------- end python_4 ----------
python_5 = PythonScript(x=number_slider_4)  # -> out, a; same code as python_4
python_6 = PythonScript(x=number_slider_2)  # -> out, a
# ---------- python_6: Python ----------
a = -x+90
# ---------- end python_6 ----------
open_port = OpenClosePort(OpenClosePort=Toggle(True), PortNumber=ports_available, BaudRate=115200)
panel_2 = Panel(python.a1Servo)
panel_3 = Panel(python_5.a)
panel_4 = Panel(python_4.a)
panel_5 = Panel(python_2.a)
panel_6 = Panel(python_6.a)
panel_7 = Panel(python_3.a)
forward_kinematics = CSharpScript(
    P1=pt,
    P2=pt_3,
    P3=pt_2,
    P4=pt_4,
    A1=filter_2,
    A2=filter_3,
    A3=filter_4,
    A4=filter_5,
    A5=filter_6,
    A6=filter_7,
    BasePlane=xy,
    J1=mesh,
    J2=mesh_2,
    J3=mesh_3,
    J4=mesh_4,
    J5=mesh_5,
    J6=mesh_6,
    J7=mesh_7)  # -> out, Robot, EndPlane; inputs P1: Point3d, P2: Point3d, P3: Point3d, P4: Point3d, A1: Double, A2: Double, A3: Double, A4: Double, A5: Double, A6: Double, BasePlane: Plane, J1: Mesh, J2: Mesh, J3: Mesh, J4: Mesh, J5: Mesh, J6: Mesh, J7: Mesh
# ---------- forward_kinematics: C# ----------
    //your code here
    double pi = Math.PI;
    double A1Rad = (A1 / 180) * pi;
    double A2Rad = (A2 / 180) * pi;
    double A3Rad = (A3 / 180) * pi;
    double A4Rad = (A4 / 180) * pi;
    double A5Rad = (A5 / 180) * pi;
    double A6Rad = (A6 / 180) * pi;

    Mesh[] RobotMesh = {J1, J2, J3, J4, J5, J6, J7};
    Plane AP1 = Plane.WorldZX;
    AP1.Origin = P1;
    Plane AP2 = Plane.WorldZX;
    AP2.Origin = P2;
    Plane AP3 = Plane.WorldYZ;
    AP3.Origin = P3;
    Plane AP4 = Plane.WorldZX;
    AP4.Origin = P3;
    Plane AP5 = Plane.WorldYZ;
    AP5.Origin = P3;
    Plane AP6 = Plane.WorldYZ;
    AP6.Origin = P4;

    Plane[] AxisPlanes = {AP1,AP2,AP3,AP4,AP5,AP6};

    Transform Rot1 = Rhino.Geometry.Transform.Rotation(-1 * A1Rad, BasePlane.ZAxis, BasePlane.Origin);

    for (int i = 1;i < 7;i++)
    {
      RobotMesh[i].Transform(Rot1);
    }
    for (int i = 0; i < 6;i++)
    {
      AxisPlanes[i].Transform(Rot1);
    }

    Transform Rot2 = Rhino.Geometry.Transform.Rotation(A2Rad + pi / 2, AxisPlanes[0].ZAxis, AxisPlanes[0].Origin);

    for (int i = 2;i < 7;i++)
    {
      RobotMesh[i].Transform(Rot2);
    }
    for (int i = 1; i < 6;i++)
    {
      AxisPlanes[i].Transform(Rot2);
    }

    Transform Rot3 = Rhino.Geometry.Transform.Rotation(A3Rad - pi / 2, AxisPlanes[1].ZAxis, AxisPlanes[1].Origin);

    for (int i = 3;i < 7;i++)
    {
      RobotMesh[i].Transform(Rot3);
    }
    for (int i = 2; i < 6;i++)
    {
      AxisPlanes[i].Transform(Rot3);
    }

    Transform Rot4 = Rhino.Geometry.Transform.Rotation(A4Rad * -1.0, AxisPlanes[2].ZAxis, AxisPlanes[2].Origin);

    for (int i = 4;i < 7;i++)
    {
      RobotMesh[i].Transform(Rot4);
    }
    for (int i = 3; i < 6;i++)
    {
      AxisPlanes[i].Transform(Rot4);
    }

    Transform Rot5 = Rhino.Geometry.Transform.Rotation(A5Rad, AxisPlanes[3].ZAxis, AxisPlanes[3].Origin);

    for (int i = 5;i < 7;i++)
    {
      RobotMesh[i].Transform(Rot5);
    }
    for (int i = 4; i < 6;i++)
    {
      AxisPlanes[i].Transform(Rot5);
    }

    Transform Rot6 = Rhino.Geometry.Transform.Rotation(-1.0 * A6Rad, AxisPlanes[4].ZAxis, AxisPlanes[4].Origin);

    for (int i = 6;i < 7;i++)
    {
      RobotMesh[i].Transform(Rot6);
    }
    for (int i = 5; i < 6;i++)
    {
      AxisPlanes[i].Transform(Rot6);
    }

    Robot = RobotMesh;

    EndPlane = AxisPlanes[5];
# ---------- end forward_kinematics ----------
uno_write = UnoWrite(
    StartWritingValues=Toggle(True),
    DigitalPin13=0,
    DigitalPin12=0,
    DigitalPin11=0,
    DigitalPin10=0,
    DigitalPin9=panel_2,
    DigitalPin8=0,
    DigitalPin6=0,
    DigitalPin5=0,
    DigitalPin3=0,
    PortNumber=ports_available)  # -> ArduinoOutput, StatusMessage
ahsv = SplitAHSV(Colour=ColourSwatch(SwatchColor=RGB(237, 64, 64)))  # -> Alpha, Hue, Saturation, Value
hsl = ColourHSL(Alpha=Slider(1, range=0..1), Hue=ahsv.Hue, Saturation=ahsv.Saturation, Luminance=ahsv.Value)
preview = CustomPreview(Geometry=forward_kinematics.Robot, Shader=hsl)

# ==== cluster Cluster
solver_id = ClusterInput()
a6 = ClusterInput()
a4 = ClusterInput()
a2 = ClusterInput()
a5 = ClusterInput()
a3 = ClusterInput()
a1 = ClusterInput()
item = ListItem(List=a6, Index=solver_id, Wrap=True)
item_2 = ListItem(List=a4, Index=solver_id, Wrap=True)
item_3 = ListItem(List=a2, Index=solver_id, Wrap=True)
item_4 = ListItem(List=a5, Index=solver_id, Wrap=True)
item_5 = ListItem(List=a3, Index=solver_id, Wrap=True)
item_6 = ListItem(List=a1, Index=solver_id, Wrap=True)
a1_2 = ClusterOutput(item_6)
a2_2 = ClusterOutput(item_3)
a4_2 = ClusterOutput(item_2)
a5_2 = ClusterOutput(item_4)
a3_2 = ClusterOutput(item_5)
a6_2 = ClusterOutput(item)
