# Grasshopper definition Counter.gh (Grasshopper 0.9.76)
# plug-ins: Firefly.X

timer = Timer(TimerInterval=20, Target=counter)
crv = Curve(<curve referenced from the Rhino model>)
counter = Counter(CountDirection=Toggle(True), Step=".005", StartStop=Toggle(True), Reset=Button(), OptionalCounterDomain="0 to 1")
pframe = PerpFrame(Curve=reparameterize(crv), Parameter=counter)
